# Grasshopper definition C#ScriptingForGrasshopperSamples_WS_004.gh (Grasshopper 1.0.7)
# Copyright: bernhard muller bijoutiers
# plug-ins: Workshop, Bifocals, Pufferfish

# ----
# The Grasshopper C# Component
# 
# List Access
number_slider = Slider(2, range=0..10)
series = Series(Start=number_slider, Step=Slider(1, range=0..10), Count=Slider(2, range=0..10))
shift = ShiftList(List=series, Shift=Slider(3, range=0..10), Wrap=True)
c_script = CSharpScript(xList=series, yList=shift, z=Slider(0, range=0..10))  # -> out, A, B; inputs xList: list of Double, yList: list of Double, z: Int32
# ---------- c_script: C# ----------
    List<double> newList1 = new List<double>();
    foreach( var x in xList)
      newList1.Add(x + 10);
    Print("List Access runs only once, # of iterations = " + Iteration);
    A = newList1;
    
    List<double> newList2 = new List<double>();
    foreach( var x in yList)
      newList2.Add(x + 2 * z);
    Print("List Access runs only once, # of iterations = " + Iteration);
    B = newList2;
# ---------- end c_script ----------
panel = Panel(c_script.A)
dom = ConstructDomain(DomainStart=Slider(0.57, range=0..2), DomainEnd=Slider(1.88, range=0..5))
panel_2 = Panel(c_script.out)
lng = ListLength(List=c_script.B)
panel_3 = Panel(c_script.B)
range = Range(Domain=dom, Steps=expr("x-1", lng))
number_slider_2 = Slider(6, range=0..6)
qsph = QuadSphere(Base=PlaneXY(0, 0, 0), Radius=range)
debrep = DeconstructBrep(Brep=qsph)  # -> Faces, Edges, Vertices
split = SplitList(List=debrep.Faces, Index=number_slider_2)  # -> ListA, ListB
listdexs = ListIndices(List=split.ListA)
X = UnitX(Factor=c_script.B)
item = ListItem(List=debrep.Faces, Index=listdexs, Wrap=True)
move = Move(Geometry=graft(item), Motion=X)  # -> Geometry, Transform
arrpolar = PolarArray(Geometry=move.Geometry, Plane=PlaneXY(0, 0, 0), Count=number_slider_2, Angle=6.283185307)  # -> flatten(Geometry), Transform
neg = Negative(Value=number_slider_2)
panel_4 = Panel(arrpolar.Geometry)
lng_2 = ListLength(List=arrpolar.Geometry)
dom_2 = ConstructDomain(DomainStart=neg, DomainEnd=number_slider_2)
range_2 = Range(Domain=dom_2, Steps=expr("x-1", lng_2))
Z = UnitZ(Factor=range_2)
jitter = Jitter(List=Z, Jitter=Slider(0.24, range=0..1), Seed=2)  # -> Values, Indices
move_2 = Move(Geometry=arrpolar.Geometry, Motion=jitter.Values)  # -> Geometry, Transform

# ----
# The Grasshopper C# Component
# 
# Tree Access
qsph_2 = QuadSphere(Base=PlaneXY(0, 0, 0), Radius=1)

# ----
# The Grasshopper C# Component
# 
# Item Access
number_slider_3 = Slider(10, range=0..10)
series_2 = Series(Start=Slider(100, range=0..100), Step=Slider(10, range=0..10), Count=number_slider_3)
jitter_2 = Jitter(List=series_2, Jitter=Slider(1, range=0..1), Seed=Slider(12, range=0..100))  # -> Values, Indices
panel_5 = Panel(series_2)
c_script_2 = CSharpScript(x=series_2, y=jitter_2.Values)  # -> out, A, B; inputs x: Double, y: Double
# ---------- c_script_2: C# ----------
    A = 0.10 * (x + y);
    B = x / y;
    Print("Rajaa Issa's got iteration " + Iteration + " figured out!");
# ---------- end c_script_2 ----------
panel_6 = Panel(jitter_2.Values)
panel_7 = Panel(c_script_2.out)
panel_8 = Panel(c_script_2.A)
panel_9 = Panel(c_script_2.B)
lng_3 = ListLength(List=c_script_2.A)
dom_3 = ConstructDomain(DomainStart=Slider(2, range=0..2), DomainEnd=Slider(5, range=0..5))
X_2 = UnitX(Factor=c_script_2.A)
range_3 = Range(Domain=dom_3, Steps=expr("x-1", lng_3))
genes = GenePool(
    Decimals=0,
    Maximum=10,
    Minimum=0,
    Value=[9.423100888, 8.036045399, 0.5896379848, 1.092948397, 4.504869061, 3.043187765, 2.959585834, 9.833903359, 0.7324921064, 1.092993706])
sph = Sphere(Base=PlaneXY(0, 0, 0), Radius=range_3)
panel_10 = Panel("-1")
move_3 = Move(Geometry=sph, Motion=X_2)  # -> Geometry, Transform
item_2 = ListItem(List=c_script_2.B, Index=genes, Wrap=True)
lng_4 = ListLength(List=move_3.Geometry)
range_4 = Range(Domain=item_2, Steps=expr("x-1", lng_4))
pi = Pi(Factor=range_4)  # -> simplify(Output)
rot3d = Rotate3D(Geometry=move_3.Geometry, Angle=pi, Center=Point(0, 0, 0), Axis=Vector(0, 0, 1))  # -> flatten(Geometry), Transform
volume = Volume(Geometry=rot3d.Geometry)  # -> Volume, Centroid
graph = GraphMapper(
    c_script_2.B,
    x0=0,
    x1=1,
    y0=0,
    y1=1,
    Ox=0.4657400846,
    Oy=0.4071531296,
    Px=0.728559196,
    Py=0.4514133334,
    container_name="Parabola")
remap = Remap(data=c_script_2.B, min=Slider(0, range=0..0.01), max=Slider(1, range=0..1))
nurbs = NurbsCurve(Degree=3, Periodic=False)  # -> Curve, Length, Domain
intcrv = Interpolate(Vertices=volume.Centroid, Degree=3, Periodic=False, KnotStyle=1)  # -> Curve, Length, Domain
vpipe = PipeVariable(Curve=reparameterize(intcrv.Curve), Parameters=remap, Radii=graph, Caps="2")
merge = Merge(Data1=rot3d.Geometry, Data2=vpipe)
bang = ExplodeTree(Data=merge)  # -> Branch0, _0000
geo = Geometry(bang.Branch0)
geo_2 = Geometry(bang._0000)
viewer = ParamViewer(bang.Branch0)
panel_11 = Panel(bang.Branch0)
panel_12 = Panel(bang._0000)

# ----
# The Grasshopper C# Component
# 
# Tree Access
number_slider_4 = Slider(28, range=0..100)
crv = Curve([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])
divide = DivideCurve(Curve=crv, Count=Slider(8, range=0..10), Kinks=False)  # -> Points, Tangents, Parameters
qsph_3 = QuadSphere(Base=PlaneXY(0, 0, 0), Radius=number_slider_4)
genes_2 = GenePool(
    Decimals=0,
    Maximum=12,
    Minimum=0,
    Value=[3.441087318, 9.058384419, 8.120174443, 8.52467268, 8.55288221, 10.30299228, 6.292031813, 7.087729524, 0.9963816185, 7.331634827, 2.528745226, 3.640362289])
debrep_2 = DeconstructBrep(Brep=qsph_3)  # -> Faces, Edges, Vertices
c_script_3 = CSharpScript(Allpts=divide.Points, radius=Slider(3.27, range=0..10))  # -> out, AllSpheres, Allpts; inputs Allpts: Point3d, radius: Double
# ---------- c_script_3: C# ----------
    Sphere ptSphere = new Sphere(Allpts, radius);
    Print("Item access runs " + Iteration + " times.");
    AllSpheres = ptSphere;
# ---------- end c_script_3 ----------
c_script_4 = CSharpScript()  # -> Out, SpheresA, SpheresB
viewer_2 = ParamViewer(c_script_3.AllSpheres)
panel_13 = Panel(c_script_3.Allpts)
viewer_3 = ParamViewer(divide.Points)
pt = Point(divide.Points)
panel_14 = Panel(genes_2)
c_script_5 = CSharpScript()  # -> Out, SpheresA, SpheresB
item_3 = ListItem(List=debrep_2.Edges, Index=genes_2, Wrap=True)
crv_2 = Curve(item_3)
divide_2 = DivideCurve(Curve=crv_2, Count=Slider(1, range=1..3), Kinks=False)  # -> Points, Tangents, Parameters
bang_2 = ExplodeTree(Data=pt)  # -> Branch0, Branch1
c_script_6 = CSharpScript(Allpts=divide_2.Points, radius=Slider(3.27, range=0..10))  # -> out, AllSpheres, Allpts_Out; inputs Allpts: Point3d, radius: Double
# ---------- c_script_6: C# ----------
    Sphere ptSphere = new Sphere(Allpts, radius);
    Print("Item access runs " + Iteration + " times.");
    AllSpheres = ptSphere;
    Allpts_Out = Allpts;
# ---------- end c_script_6 ----------
ln = Line(StartPoint=bang_2.Branch0, EndPoint=bang_2.Branch1)
viewer_4 = ParamViewer(c_script_6.AllSpheres)
viewer_5 = ParamViewer(divide_2.Points)
pipe = Pipe(Curve=ln, Radius=1, Caps=0)
panel_15 = Panel(c_script_6.Allpts_Out)
shift_2 = ShiftList(List=c_script_6.Allpts_Out, Shift=1, Wrap=True)
ln_2 = Line(StartPoint=c_script_6.Allpts_Out, EndPoint=shift_2)
pipe_2 = Pipe(Curve=ln_2, Radius=1, Caps=0)

# ----
# Essential Guide to C# Scripting
# inspired by: Rajaa Issa
# The Grasshopper C# Component
wickerson_s_first_grasshopper_component = WickersonsFirstGrasshopperComponent()  # disabled
genes_3 = GenePool(
    Decimals=0,
    Maximum=100,
    Minimum=0,
    Value=[26.00110165, 58.48794848, 18.50926313, 22.38775521, 50.92372608, 5.508037985, 64.50332332, 87.46321243, 32.0196855, 36.53144456])
iseven_isodd_c_script = CSharpScript(num=genes_3)  # -> out, IsEven, IsOdd; inputs num: Int32
# ---------- iseven_isodd_c_script: C# ----------
    int mod1 = num % 2;
    IsEven = (mod1 == 0 ? true : false);

    int mod2 = num % 2;
    IsOdd = (mod2 == 1 ? true : false);
# ---------- end iseven_isodd_c_script ----------
panel_16 = Panel(genes_3)
panel_17 = Panel(iseven_isodd_c_script.IsOdd)
panel_18 = Panel(iseven_isodd_c_script.IsEven)
int = Integer(iseven_isodd_c_script.IsEven)
panel_19 = Panel(int)
sph_2 = Sphere(Base=PlaneXY(0, 0, 0), Radius=1)
X_3 = UnitX(Factor=int)
number_slider_5 = Slider(2, range=0..2)
move_4 = Move(Geometry=sph_2, Motion=X_3)  # -> Geometry, Transform
lng_5 = ListLength(List=move_4.Geometry)
number_slider_6 = Slider(1, range=0..1)
range_5 = Range(Domain=number_slider_5, Steps=expr("x-1", lng_5))
vec = VectorXYZ(XComponent=0, YComponent=0, ZComponent=number_slider_6)  # -> Vector, Length
pi_2 = Pi(Factor=range_5)
vec_2 = VectorXYZ(XComponent=number_slider_6, YComponent=0, ZComponent=0)  # -> Vector, Length
rot3d_2 = Rotate3D(Geometry=move_4.Geometry, Angle=pi_2, Center=Point(0, 0, 0), Axis=vec.Vector)  # -> Geometry, Transform

int_2 = Integer(iseven_isodd_c_script.IsOdd)

panel_20 = Panel(int_2)
Z_2 = UnitZ(Factor=int_2)
move_5 = Move(Geometry=sph_2, Motion=Z_2)  # -> Geometry, Transform
lng_6 = ListLength(List=move_5.Geometry)
range_6 = Range(Domain=number_slider_5, Steps=expr("x-1", lng_6))
pi_3 = Pi(Factor=range_6)
rot3d_3 = Rotate3D(Geometry=move_5.Geometry, Angle=pi_3, Center=Point(0, 0, 0), Axis=vec_2.Vector)  # -> Geometry, Transform
merge_2 = Merge(Data1=rot3d_2.Geometry, Data2=rot3d_3.Geometry)
sunion = SolidUnion(Breps=merge_2)

# ----
# The Grasshopper C# Component
# 
# List Access
number_slider_7 = Slider(4, range=0..10)
series_3 = Series(Start=number_slider_7, Step=Slider(3, range=0..10), Count=Slider(7, range=0..10))
panel_21 = Panel(series_3)

# ---- group: Sum
c_script_7 = CSharpScript(xList=series_3)  # -> out, Sum; inputs xList: list of Double
# ---------- c_script_7: C# ----------
    double xSum = 0;
    foreach (var x in xList)
      xSum += x;
    Print("# of interations " + Iteration);
    Sum = xSum;
# ---------- end c_script_7 ----------

# ----
panel_22 = Panel(c_script_7.out)
panel_23 = Panel(c_script_7.Sum)

# ==== cluster Remap: Remaps numbers
data = ClusterInput()
min = ClusterInput()
max = ClusterInput()
bnd = Bounds(Numbers=data)
dom = ConstructDomain(DomainStart=min, DomainEnd=max)
remap = RemapNumbers(Value=data, Source=bnd, Target=dom)  # -> Mapped, Clipped
R = ClusterOutput(remap.Mapped)
